# Grasshopper definition export_scene.gh (Grasshopper 1.0.7)
# plug-ins: glTFexporter

mesh = Mesh(<mesh referenced from the Rhino model>)
mesh_2 = Mesh(<mesh referenced from the Rhino model>)
mesh_3 = Mesh(<mesh referenced from the Rhino model>)
mesh_4 = Mesh(<mesh referenced from the Rhino model>)
mesh_5 = Mesh(<mesh referenced from the Rhino model>)
mesh_6 = Mesh(<mesh referenced from the Rhino model>)
merge = Merge(Data1=mesh_4, Data2=mesh_5)
merge_2 = Merge(Data1="house", Data2="building")
normalmat = MeshNormalMaterial(Wireframe=False, WireframeLineJoin="round", WireframeLineWidth=1)  # -> JSON, Material
basicmat = MeshBasicMaterial(Color=ColourSwatch(SwatchColor=RGB(255, 132, 87)), Wireframe=False, WireframeLineJoin="round", WireframeLineWidth=1)  # -> JSON, Material
basicmat_2 = MeshBasicMaterial(
    Color=ColourSwatch(SwatchColor=RGB(255, 132, 87)),
    Wireframe=Toggle(True),
    WireframeLineJoin="round",
    WireframeLineWidth=Slider(10, range=0..10))  # -> JSON, Material
meshstdrdmat = MeshStandardMaterial(
    Color=ColourSwatch(SwatchColor=RGB(255, 255, 255)),
    Opacity=Slider(1, range=0..1),
    Roughness=Slider(1, range=0..1),
    Metalness=Slider(0.5, range=0..1),
    Emissive=0,
    Wireframe=False,
    WireframeLineJoin="round",
    WireframeLineWidth=1)  # -> JSON, Material
meshstdrdmat_2 = MeshStandardMaterial(
    Color=ColourSwatch(SwatchColor=RGB(117, 250, 159)),
    Opacity=Slider(1, range=0..1),
    Roughness=Slider(1, range=0..1),
    Metalness=Slider(0.5, range=0..1),
    Emissive=0,
    Wireframe=False,
    WireframeLineJoin="round",
    WireframeLineWidth=1)  # -> JSON, Material
mesh_7 = Mesh(Mesh=mesh, Name="torus", Material=normalmat.Material)  # -> JSON, Geometry
mesh_8 = Mesh(Mesh=mesh_2, Name="box", Material=basicmat.Material)  # -> JSON, Geometry
mesh_9 = Mesh(Mesh=mesh_3, Name="wire_box", Material=basicmat_2.Material)  # -> JSON, Geometry
mesh_10 = Mesh(Mesh=merge, Name=merge_2, Material=meshstdrdmat.Material)  # -> JSON, Geometry
mesh_11 = Mesh(Mesh=mesh_6, Name="ground", Material=meshstdrdmat_2.Material)  # -> JSON, Geometry
merge_3 = Merge(Data1=mesh_7.Geometry, Data2=mesh_8.Geometry, Data3=mesh_9.Geometry, Data4=mesh_10.Geometry, Data5=mesh_11.Geometry)
scene = CompileScene(Geometry=merge_3)  # -> JSON, Scene
json = ExportJSON(Path="C:\Users\dee\Desktop\vue-threejs-template\public\3d", FileName="City_Test", Data=scene.JSON)
