# Grasshopper definition export_scene.gh (Grasshopper 1.0.7)
# plug-ins: glTFexporter

mesh = Mesh(<mesh referenced from the Rhino model>)
mesh_2 = Mesh(<mesh referenced from the Rhino model>)
mesh_3 = Mesh(<mesh referenced from the Rhino model>)
mesh_4 = Mesh(<mesh referenced from the Rhino model>)
mesh_5 = Mesh(<mesh referenced from the Rhino model>)
merge = Merge(Data1=mesh, Data2=mesh_2, Data3=mesh_3, Data4=mesh_4)
merge_2 = Merge(Data1="torus", Data2="box", Data3="house", Data4="building")
meshstdrdmat = MeshStandardMaterial(
    Color=ColourSwatch(SwatchColor=RGB(255, 255, 255)),
    Opacity=Slider(1, range=0..1),
    Roughness=Slider(1, range=0..1),
    Metalness=Slider(0.5, range=0..1),
    Emissive=0,
    Wireframe=False,
    WireframeLineJoin="round",
    WireframeLineWidth=1)  # -> JSON, Material
meshstdrdmat_2 = MeshStandardMaterial(
    Color=ColourSwatch(SwatchColor=RGB(117, 250, 159)),
    Opacity=Slider(1, range=0..1),
    Roughness=Slider(1, range=0..1),
    Metalness=Slider(0.5, range=0..1),
    Emissive=0,
    Wireframe=False,
    WireframeLineJoin="round",
    WireframeLineWidth=1)  # -> JSON, Material
geo = BufferGeometry(Mesh=mesh_5, Name="ground", Material=meshstdrdmat_2.Material)  # -> JSON, Mesh
geo_2 = BufferGeometry(Mesh=merge, Name=merge_2, Material=meshstdrdmat.Material)  # -> JSON, Mesh
merge_3 = Merge(Data1=geo_2.Mesh, Data2=geo.Mesh)
scene = CompileScene(Geometry=merge_3)  # -> JSON, Scene
json = ExportJSON(Path="C:\Users\dee\Desktop\vue-threejs-template\public\3d", FileName="City_Test", Data=scene.JSON)
